# Grasshopper definition HVACSystemWorkflow.gh (Grasshopper 1.0.7)
# plug-ins: Ironbug.Grasshopper

brep = Brep([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])
honeybee = Honeybee_Honeybee()  # -> Vviiiiiiiiiizzz; plug-in component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
ladybug = Ladybug_Ladybug()  # -> Vviiiiiiiiiizzz; plug-in component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
intersectmass = IntersectMass(x=brep)  # -> out, A; inputs x: list of Brep
# ---------- intersectmass: C# ----------
    var tolerance = Rhino.RhinoDoc.ActiveDoc.ModelAbsoluteTolerance;
    List<Brep> allOldBreps = x;

    if (x.Count() > 0)
    {
      var results = allOldBreps.AsParallel().AsOrdered().Select(b => SplitBrepWithBreps(b, allOldBreps, tolerance));
      A = results;
    }

    //SplitBrepWithBreps(x[0], x, tolerance);
# ---------- intersectmass: C# additional code ----------
  static Brep SplitBrepWithBreps(Brep CurrentBrep, List<Brep> AllBreps, double tolerance)
  {
    var currentBrep = CurrentBrep;
    var allBreps = AllBreps;

    foreach (Brep item in allBreps)
    {
      var  tempBrep = currentBrep.Split(item, tolerance);
      if (tempBrep.Count() > 0)
      {
        var newBrep = Rhino.Geometry.Brep.JoinBreps(tempBrep, tolerance);

        currentBrep = newBrep.First();
        currentBrep.Faces.ShrinkFaces();
      }
    }
    return currentBrep;

  }
# ---------- end intersectmass ----------
number_slider = Slider(0.7, range=0..1)
mass2zone = Honeybee_Masses2Zones(zoneMasses=flatten(intersectmass.A), maxRoofAngle=30, createHBZones=Toggle(True))  # -> readMe, HBZones; plug-in component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
panel = Panel("https://www.energyplus.net/weather-download/north_and_central_america_wmo_region_4/USA/NY/USA_NY_New.York-LaGuardia.AP.725030_TMY3/all")
glzparamlist = Honeybee_GlazingParametersList(northGlzParam=0, westGlzParam=0, southGlzParam=number_slider, eastGlzParam=number_slider)  # -> glzParamList; plug-in component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
hvactemplate = Ironbug_HVACTemplate()
solveadjc = Honeybee_SolveAdjacencies(HBZones=flatten(mass2zone.HBZones), removeCurrentAdjc=False, findAdjc=Toggle(True))  # -> readMe, HBZonesWADJ; plug-in component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
glazingcreator = Honeybee_GlazingBasedOnRatio(HBObjects=solveadjc.HBZonesWADJ, glzRatio=glzparamlist, runIt=Toggle(True))  # -> readMe, HBObjWGLZ; plug-in component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
data = Data(flatten(glazingcreator.HBObjWGLZ))
epw_stat = Ladybug_OpenEPWAndSTATWeatherFiles(weatherFileURL=panel)  # -> epwFile, statFile; plug-in component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
pipeadiabatic = Ironbug_PipeAdiabatic()
hvacsystemslist = Honeybee_HVACSystemsList({"-1. Thermostat Only": -1, "0. Ideal Air Loads": 0, "1. PTAC | Residential": 1, "2. PTHP | Residential": 2, "3. Packaged Single Zone - AC": 3, "4. Packaged Single Zone - HP": 4, "5. Packaged VAV w/ Reheat": 5, "6. Packaged VAV w/ PFP Boxes": 6, "7. VAV w/ Reheat": 7, "8. VAV w/ PFP Boxes": 8, "9. Warm Air Furnace - Gas Fired": 9, "10.Warm Air Furnace - Electric": 10, "11.Fan Coil Units + DOAS": 11, "12.Active Chilled Beams + DOAS": 12, "13.Radiant Floors + DOAS": 13, "14.Custom Rad Surfaces + DOAS": 14, "15.Heated Surfaces + VAV Cooling": 15, "16.VRF + DOAS": 16, "17.WSHP + DOAS": 17}, selected="1. PTAC | Residential")
hvacsystem = Honeybee_AssignHVACSystem(HBZones=glazingcreator.HBObjWGLZ, HVACSystems=hvacsystemslist)  # -> readMe, HBZones; plug-in component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
toggle = BooleanToggle(True)
toggle_2 = BooleanToggle(True)
exporttoopenstudio = Honeybee_ExportToOpenStudio(
    epwWeatherFile=epw_stat.epwFile,
    HBZones=flatten(hvacsystem.HBZones),
    writeOSM=toggle_2,
    openOpenStudio=toggle_2,
    fileName="HB_Sys")  # -> readMe, osmFileAddress, idfFileAddress, resultFileAddress, eioFileAddress, rddFileAddress, htmlReport, studyFolder, model; plug-in component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
readepresult = Honeybee_ReadEPResult(resultFileAddress=exporttoopenstudio.resultFileAddress)  # -> totalThermalLoad, thermalLoadBalance, cooling, heating, electricLight, electricEquip, fanElectric, pumpElectric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; plug-in component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
strnum = Ladybug_SeparateData(inputList=flatten(readepresult.cooling))  # -> numbers, strings; plug-in component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
strnum_2 = Ladybug_SeparateData(inputList=flatten(readepresult.heating))  # -> numbers, strings; plug-in component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
ma = MassAddition(Input=flatten(strnum.numbers))  # -> Result, PartialResults
ma_2 = MassAddition(Input=strnum_2.numbers)  # -> Result, PartialResults
panel_2 = Panel(ma_2.Result)
panel_3 = Panel(ma.Result)
timer = Timer(TimerInterval=1000)
list = ValueList({"One": 1, "Two": 2, "Three": 2² - 1, "Four": Sqrt(16)}, selected="One")
knob = ControlKnob(Decimals=2, Limit=True, Maximum=10, Minimum=0, Range=1, Value=1.03)
digit_scroller = DigitScroller(Scroller_Digits=12, Scroller_Radix=9, Scroller_Value=0.25)
item = CherryPicker(ListIndex=0)
gradient = Gradient(LowerLimit=0, UpperLimit=1, stops=[0.15: RGB(255, 130, 160), 0.85: RGB(220, 0, 40)])
dam = DataDam(BufferDelay=10000000, BufferMode=0)
nblur = BlurNumbers(Strength=0.5, Iterations=1, Lock=True, Wrap=False)
hvactemplate_2 = Ironbug_HVACTemplate(_run=Button())
list_2 = ValueList({"One": 1, "Two": 2, "Three": 2² - 1, "Four": Sqrt(16)}, selected="One")

# ----
# PTAC
lng = ListLength(List=data)
coilhw = Ironbug_CoilHeatingWater()  # -> AirSide_CoilHeatingWater, WaterSide_CoilHeatingWater
objparams = Ironbug_ObjParams(PressureRise="500", DataFieldSetType="Ironbug.HVAC.IB_FanConstantVolume_DataFields")
duplicate = Ironbug_Duplicate(Reference=coilhw.AirSide_CoilHeatingWater, Amount=flatten(lng))  # -> graft(Objects), graft(WaterSide_CoilHeatingWater)
fanconstant = Ironbug_FanConstantVolume(Parameters_=objparams)
ptac = Ironbug_ZoneHVACPackagedTerminalAirConditioner(HeatingCoil=duplicate.Objects, Fan_=fanconstant)

zoneequipmentgroup = Ironbug_ZoneEquipmentGroup(ZoneEquipments=ptac)  # -> flatten(ZoneEquipmentGroup)

# ----
# Hot water loop
boilerhw = Ironbug_BoilerHotWater()
spscheduled = Ironbug_SetpointManagerScheduled(Temperature="67")
pumpvariable = Ironbug_PumpVariableSpeed()
branches = PlantBranches(B1=boilerhw, B2=pipeadiabatic)
branches_2 = PlantBranches(Branch1=duplicate.WaterSide_CoilHeatingWater)
hwloop = Ironbug_HotWaterPlantLoop(Supply=[pumpvariable, branches, spscheduled], Demand=branches_2)

# ----
# HBZones
data_2 = Data(flatten(data))

thermalzone = Ironbug_ThermalZone(HoneybeeZone=data_2, ZoneEquipments=zoneequipmentgroup)
noairloop = Ironbug_NoAirLoop(OSZones=thermalzone)

hvacsystem_2 = Ironbug_HVACSystem(AirLoops=flatten(noairloop), PlantLoops=flatten(hwloop))

exporttoopenstudio_2 = Honeybee_ExportToOpenStudio(
    epwWeatherFile=epw_stat.epwFile,
    HBZones=flatten(glazingcreator.HBObjWGLZ),
    HVACSystem=flatten(hvacsystem_2),
    writeOSM=toggle,
    openOpenStudio=toggle,
    fileName="IB_Sys")  # -> readMe, osmFileAddress, idfFileAddress, resultFileAddress, eioFileAddress, rddFileAddress, htmlReport, studyFolder, model; plug-in component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
c_script = CSharpScript(x=exporttoopenstudio_2.osmFileAddress, Reference="C:\openstudio-2.5.0\CSharp\openstudio\OpenStudio.dll")  # -> out, A; inputs x: String; disabled
# ---------- c_script: C# ----------
    if (!string.IsNullOrEmpty(x))
    {
      var p = new OpenStudio.Path(x);
      var m = OpenStudio.Model.load(p).get();
      var plantLps = m.getPlantLoops();
      foreach (OpenStudio.PlantLoop pl in plantLps)
      {
        
        var tp = pl.sizingPlant().loopType();
        Print(pl.nameString() + "_" + tp);
      }
    }
# ---------- end c_script ----------
readepresult_2 = Honeybee_ReadEPResult(resultFileAddress=exporttoopenstudio_2.resultFileAddress)  # -> totalThermalLoad, thermalLoadBalance, cooling, heating, electricLight, electricEquip, fanElectric, pumpElectric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; plug-in component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
panel_6 = Panel(exporttoopenstudio_2.osmFileAddress)
strnum_3 = Ladybug_SeparateData(inputList=flatten(readepresult_2.cooling))  # -> numbers, strings; plug-in component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
strnum_4 = Ladybug_SeparateData(inputList=flatten(readepresult_2.heating))  # -> numbers, strings; plug-in component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
ma_3 = MassAddition(Input=flatten(strnum_3.numbers))  # -> Result, PartialResults
ma_4 = MassAddition(Input=strnum_4.numbers)  # -> Result, PartialResults
panel_7 = Panel(ma_4.Result)
panel_8 = Panel(ma_3.Result)
